# Grasshopper definition Snitch.gh (Grasshopper 1.0.7)
# plug-ins: Grasshopper-Tekla Link 2021.1.12, SnitchGrasshopper, jSwan, Wombat, Kangaroo2 Components, Pufferfish

mo = ModelObject(
    [null x540],
    ModelID="Snitch.db1",
    ModelObjectInfos=["Tekla.Structures.Model.Assembly, Tekla.Structures.Model, Version=2021.0.0.0, Culture=neutral, PublicKeyToken=2f04dbe497b71114;52766bdf-1369-49e6-9556-0d7dfbb2a9ce", "Tekla.Structures.Model.Assembly, Tekla.Structures.Model, Version=2021.0.0.0, Culture=neutral, PublicKeyToken=2f04dbe497b71114;21c78a11-c348-40cc-b59d-6893cac5b166", "Tekla.Structures.Model.Assembly, Tekla.Structures.Model, Version=2021.0.0.0, Culture=neutral, PublicKeyToken=2f04dbe497b71114;6efb6c13-4e4e-430c-844d-77ef7845fde1", "Tekla.Structures.Model.Assembly, Tekla.Structures.Model, Version=2021.0.0.0, Culture=neutral, PublicKeyToken=2f04dbe497b71114;08442831-8642-4902-8120-0458f87cbe94", "Tekla.Structures.Model.Assembly, Tekla.Structures.Model, Version=2021.0.0.0, Culture=neutral, PublicKeyToken=2f04dbe497b71114;8fe06c6f-8164-4620-9494-084c2349133f", "Tekla.Structures.Model.Assembly, Tekla.Structures.Model, Version=2021.0.0.0, Culture=neutral, PublicKeyToken=2f04dbe497b71114;87e0337d-eba0-44df-a014-f388eb7915e4"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])
mo_2 = ModelObject(simplify(graft(mo)))
deassembly = DeconstructAssembly(Assembly=mo_2)  # -> Name, Type, MainPart, Secondaries, AllObjects
pshift = ShiftPaths(Data=deassembly.AllObjects, Offset=-1)
clean = CleanTree(RemoveNulls=True, RemoveInvalid=True, RemoveEmpty=True, Tree=pshift)
cull_i = CullIndex(List=clean, Indices="0", Wrap=True)
item = ListItem(List=clean, Index="0", Wrap=True)

# ---- group: Rebars
rbr = Rebar(cull_i)
pshift_2 = ShiftPaths(Data=rbr, Offset=-1)
prop = GetProperty(TeklaObject=pshift_2, Name="WEIGHT", Type=0)
pshift_3 = ShiftPaths(Data=prop, Offset=-1)
ma = MassAddition(Input=pshift_3)  # -> Result, PartialResults

# ---- group: Slabs
plt = Plate(item)
clean_2 = CleanTree(RemoveNulls=True, RemoveInvalid=True, RemoveEmpty=True, Tree=plt)
deplate = DeconstructPlate(Plate=clean_2)  # -> Boundary, Profile, Attributes, Position, Numbering, Type
mesh = ConvertToMesh(TeklaObject=clean_2, SolidType=2)
expattributes = ExpandPartAttributes(Attributes=deplate.Attributes)  # -> Name, Profile, Material, Finish, Class, Phase, UDA
pshift_4 = ShiftPaths(Data=mesh, Offset=-1)
panel = Panel("PLATE")
cp = ControlPoints(Curve=deplate.Boundary)  # -> Points, Weights, Knots
pshift_5 = ShiftPaths(Data=cp.Points, Offset=-1)
volume = Volume(Geometry=pshift_4)  # -> Volume, Centroid
panel_2 = Panel("1")
tstat = TreeStatistics(Tree=volume.Volume)  # -> Paths, Length, Count
branch = TreeBranch(Tree=ma.Result, Path=tstat.Paths, MaintainPaths=True)
snitch_slab = SnitchSlab(
    Mesh=pshift_4,
    Polyline=deplate.Boundary,
    ConcreteVolume=volume.Volume,
    SteelMass=branch,
    ConcreteClass=expattributes.Material,
    Thickness=expattributes.Profile,
    Load="2")

# ---- group: Beam and columns
beam = Beam(item)
clean_3 = CleanTree(RemoveNulls=True, RemoveInvalid=True, RemoveEmpty=True, Tree=beam)
debeam = DeconstructBeam(Beam=clean_3)  # -> Curve, Profile, Attributes, Position, Numbering, Deforming, Type
mesh_2 = ConvertToMesh(TeklaObject=clean_3, SolidType=2)
expattributes_2 = ExpandPartAttributes(Attributes=debeam.Attributes)  # -> Name, Profile, Material, Finish, Class, Phase, UDA
cp_2 = ControlPoints(Curve=debeam.Curve)  # -> Points, Weights, Knots
pshift_6 = ShiftPaths(Data=mesh_2, Offset=-1)
pshift_7 = ShiftPaths(Data=cp_2.Points, Offset=-1)
tmatch = MatchText(Text=debeam.Type, Pattern="BEAM", Case=True)
tmatch_2 = MatchText(Text=debeam.Type, Pattern="COLUMN", Case=True)
volume_2 = Volume(Geometry=pshift_6)  # -> Volume, Centroid
dispatch = Dispatch(List=debeam.Curve, DispatchPattern=tmatch)  # -> ListA, ListB
tstat_2 = TreeStatistics(Tree=dispatch.ListA)  # -> Paths, Length, Count
dispatch_2 = Dispatch(List=volume_2.Volume, DispatchPattern=tmatch_2)  # -> ListA, ListB
dispatch_3 = Dispatch(List=expattributes_2.Material, DispatchPattern=tmatch_2)  # -> ListA, ListB
dispatch_4 = Dispatch(List=pshift_6, DispatchPattern=tmatch)  # -> ListA, ListB
dispatch_5 = Dispatch(List=debeam.Curve, DispatchPattern=tmatch_2)  # -> ListA, ListB
tstat_3 = TreeStatistics(Tree=dispatch_5.ListA)  # -> Paths, Length, Count
branch_2 = TreeBranch(Tree=ma.Result, Path=tstat_3.Paths, MaintainPaths=True)
dispatch_6 = Dispatch(List=pshift_6, DispatchPattern=tmatch_2)  # -> ListA, ListB
dispatch_7 = Dispatch(List=volume_2.Volume, DispatchPattern=tmatch_2)  # -> ListA, ListB
dispatch_8 = Dispatch(List=volume_2.Volume, DispatchPattern=tmatch)  # -> ListA, ListB
branch_3 = TreeBranch(Tree=ma.Result, Path=tstat_2.Paths, MaintainPaths=True)
dispatch_9 = Dispatch(List=expattributes_2.Material, DispatchPattern=tmatch)  # -> ListA, ListB
dispatch_10 = Dispatch(List=volume_2.Volume, DispatchPattern=tmatch)  # -> ListA, ListB
panel_3 = Panel("50")
snitch_beam = SnitchBeam(
    Mesh=dispatch_4.ListA,
    Polyline=dispatch.ListA,
    ConcreteVolume=dispatch_8.ListA,
    SteelMass=branch_3,
    ConcreteClass=dispatch_9.ListA,
    Load="40")

# ---- group: Voronoi
crv = Curve(deplate.Boundary)
end = EndPoints(Curve=debeam.Curve)  # -> Start, End
c_script = CSharpScript(curves=flatten(crv))  # -> graft(A); inputs curves: list of Curve
# ---------- c_script: C# ----------
    List<helper> newCurves = new List<helper>();
    
    foreach (var curve in curves)
    {
      Plane normal;
      curve.TryGetPlane(out normal, 0.001);
      if (normal.ZAxis.Z > 0.9)
      {
        newCurves.Add(new helper(){curve = curve, Ele = normal.Origin.Z});
      }
       
    }
    newCurves.Sort((x,y) => x.Ele.CompareTo(y.Ele));
    List<Curve> final = new List<Curve>();
    foreach (var item in newCurves)
    {
      final.Add(item.curve);
    }
    A = final;
# ---------- c_script: C# additional code ----------
  public class helper
  {
    public double Ele {get;set;}
    public Curve curve {get;set;}
  }
# ---------- end c_script ----------
boundary = BoundarySurfaces(Edges=c_script)
duppt = RemoveDuplicatePts(Points=flatten([end.Start, end.End]), Tolerance=0.01)
brep_cp = BrepClosestPoint(Point=duppt, Brep=boundary)  # -> Point, Normal, Distance
equals = Equality(FirstNumber=simplify(brep_cp.Point), SecondNumber=2)  # -> Equality, Inequality
smaller = SmallerThan(FirstNumber=brep_cp.Distance, SecondNumber="10")  # -> SmallerThan, OrEqualTo
cull = CullPattern(List=duppt, CullPattern=smaller.SmallerThan)  # -> simplify(List)
voronoi = Voronoi(Points=cull, BruteForceOverride=False)
merge = Merge(Data1=simplify(c_script), Data2=simplify(voronoi))
planar = IsPlanar(Surface=boundary, Interior=True)  # -> Planar, Plane
panel_4 = Panel(cull)
rint = RegionIntersection(CurvesA=simplify(c_script), CurvesB=simplify(voronoi), Plane=planar.Plane)
runion = RegionUnion(Curves=merge)
trim = TrimWithRegion(Curve=simplify(voronoi), Region=simplify(c_script))  # -> Inside, Outside
pshift_8 = ShiftPaths(Data=trim.Inside, Offset=-1)
crv_2 = Curve(pshift_8)
clscrv = CloseCurve(Curve=crv_2, CloseType=0, Bulge=0.5, Tolerance=0)  # -> Closed, R

# ----
snitch_column = SnitchColumn(
    Mesh=dispatch_6.ListA,
    Polyline=dispatch_5.ListA,
    ConcreteVolume=dispatch_7.ListA,
    SteelMass=branch_2,
    ConcreteClass=dispatch_3.ListA,
    Load=panel_3)
merge_2 = Merge(Data1=snitch_beam, Data2=snitch_column, Data3=snitch_slab)  # -> flatten(Result)

# ---- group: Create JSON database
snitchobject = Data(merge_2)
rejson = SerializeJson(SnitchObject=snitchobject, IncludeNullAndEmptyProperties=False)
create_json = BooleanToggle(False)
c_script_2 = CSharpScript()  # -> CurrentFolder
# ---------- c_script_2: C# usings ----------
using System.IO;
# ---------- c_script_2: C# ----------
    CurrentFolder = Path.GetDirectoryName(GrasshopperDocument.FilePath) + Path.DirectorySeparatorChar;
# ---------- end c_script_2 ----------
join = TextJoin(Text=rejson, Join=",")
concat = Concatenate(FragmentA=c_script_2, FragmentB="Database.json")
concat_2 = Concatenate(FragmentA="[", FragmentB=join, FragmentC="]")
writetxt = WriteToTextFile(Run=create_json, TextToWrite=concat_2, FilePath=concat, Append=Toggle(False), NewOnly=False)
panel_5 = Panel(writetxt)

# ----
snitch_building = SnitchBuilding(ListOfBuildingObjects=merge_2, Voronois=clscrv.Closed)
